# Grasshopper definition example.gh (Grasshopper 1.0.7)
# plug-ins: baues-toolbox Info, THERB-GH

srf = Surface([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])
# 失敗ケース
brep = Brep([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])

# ----
# 成功ケース
brep_2 = Brep([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])
srf_2 = Surface([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])

brep_3 = Brep([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])
srf_3 = Surface(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)

brep_4 = Brep([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])
srf_4 = Surface([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])

brep_5 = Brep([<brep referenced from the Rhino model> x15])
srf_5 = Surface([<surface referenced from the Rhino model> x3])
exportw = ExportW()
therb = THERB(Boxes=brep, Windows=srf, Tolerance=0.1)  # -> Therb, Test
panel = Panel(exportw)

number_slider = Slider(0.1, range=0..0.1)
windows_split = Surface([<surface referenced from the Rhino model> x3])
# step1. ジオメトリ、条件入力
rooms_split = Brep([<brep referenced from the Rhino model> x20])

# ----
# 北の方角を指定
vec = Vector()
# タスク13.fiterFaceByPropertyを実装
decompose = Decompose(Therb=therb.Therb)  # -> Rooms, Faces, Windows, Overhangs
brep_6 = Brep([<brep referenced from the Rhino model> x3])
brep_7 = Brep([<brep referenced from the Rhino model> x2])
brep_8 = Brep([<brep referenced from the Rhino model> x3])
brep_9 = Brep([<brep referenced from the Rhino model> x2])
srf_6 = Surface(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)
filterfacebyproperty = FilterFaceByProperty(Faces=decompose.Faces, Bc=1, SurfT=0, Direction=-1)  # -> TrueFace, FalseFace
srf_7 = Surface(<surface referenced from the Rhino model>)
srf_8 = Surface(<surface referenced from the Rhino model>)
therb_2 = THERB(Geometries=brep_8, Tolerance=Slider(0.1, range=0.1..10))  # -> Therb, Test
python = GhPythonScript(x=srf_6, y=Slider(0.61, range=0..1), z=Slider(0.25, range=0..1))  # -> out, a, b; inputs x: Surface
# ---------- python: Python ----------
u = x.Domain(0).ParameterAt(y)
v = x.Domain(1).ParameterAt(z)

a = x.PointAt(u, v)

b = x.Split(0, u)
# ---------- end python ----------
readproperty = ReadProperty()
updateconstruction = UpdateConstruction(Face=filterfacebyproperty.TrueFace)
srf_9 = Surface(python.b)
item = CherryPicker(therb_2.Test, ListIndex=0)
item_2 = ListItem(List=filterfacebyproperty.TrueFace, Index=Slider(5, range=0..8), Wrap=True)
digit_scroller = DigitScroller(Scroller_Digits=12, Scroller_Prefix="Index", Scroller_Radix=11, Scroller_Value=13)
python_2 = GhPythonScript(x=brep_9, y=srf_8)  # -> out, a; inputs x: list
# ---------- python_2: Python ----------
a = [x, y]
# ---------- end python_2 ----------
readproperty_2 = ReadProperty(Faces=item_2)  # -> PartId, Surface, ElementType, Normal, Direction, AdjacencyRoomId, Windows, WindowIds
exportb = ExportB(Therb=therb.Therb)
exportr = ExportR(Therb=therb.Therb)
run_simulation = RunSimulation(Therb=therb.Therb, Name="TEST", Run=Toggle(False))
panel_2 = Panel(readproperty_2.WindowIds)
item_3 = ListItem(Index=digit_scroller, Wrap=True)
srf_10 = Surface(readproperty_2.Surface)

# ----
# step2. 出力をチェック
b_datファイル書き出し = Panel(exportb)
r_datファイル書き出し = Panel(exportr)

# ----
# step03.
# サーバーにuploadする
# ための情報を入力
# step03-1. サーバーのドメイン入力
# (今のところ、ここは変える必要ないです）
# step03-2. プロジェクト名を入力
# step03-3. Trueにするとuploadして計算開始
panel_3 = Panel("http://localhost:5000/run")

uploadtherb = UploadTherb(Url=panel_3, ProjectName="demo2", Upload=Toggle(True))
# step04.
# サーバーからのresponseが表示されます。
# successとなっていれば、以下のurlをchrome
# で表示してください
# step05.
# 計算結果をPythonを利用してさらに分析することができます。
# 以下に分析例をまとめたJupyter Notebookを置いています。
# https://github.com/becat-oss/therb-notebook
panel_4 = Panel(uploadtherb)
