# Grasshopper definition example_完成イメージ.gh (Grasshopper 1.0.7)
# plug-ins: baues-toolbox Info, THERB-GH

windows_split = Surface([<surface referenced from the Rhino model> x3])
# step1. ジオメトリ、条件入力
rooms_split = Brep([<brep referenced from the Rhino model> x20])

brep = Brep([<brep referenced from the Rhino model> x3])
brep_2 = Brep([<brep referenced from the Rhino model> x2])
srf = Surface(<surface referenced from the Rhino model>)
srf_2 = Surface(<surface referenced from the Rhino model>)
therb = THERB(Geometries=brep_2, Windows=srf_2, Overhangs=srf, Tolerance=Slider(0.1, range=0..0.1))  # -> Rooms, Faces, Windows, Overhangs, Therb, Test
eval = EvaluateCurve()  # -> Point, Tangent, Angle
filterfacebyproperty = FilterFaceByProperty(Face=therb.Faces, Bc="exterior")  # -> TrueFace, FalseFace
brep_3 = Brep(therb.Test)
exportb = ExportB(Rooms=therb.Rooms, Faces=therb.Faces, Windows=therb.Windows, Overhangs=therb.Overhangs)
exportr = ExportR(Rooms=therb.Rooms, Faces=therb.Faces)

# ----
# step2. 出力をチェック
b_datファイル書き出し = Panel(exportb)
r_datファイル書き出し = Panel(exportr)

# ----
# step03.
# サーバーにuploadする
# ための情報を入力
# step03-1. サーバーのドメイン入力
# (今のところ、ここは変える必要ないです）
# step03-2. プロジェクト名を入力
# step03-3. Trueにするとuploadして計算開始
panel = Panel("http://localhost:5000/run")

uploadtherb = UploadTherb(Url=panel, ProjectName="demo2", Upload=Toggle(True))
# step04.
# サーバーからのresponseが表示されます。
# successとなっていれば、以下のurlをchrome
# で表示してください
# step05.
# 計算結果をPythonを利用してさらに分析することができます。
# 以下に分析例をまとめたJupyter Notebookを置いています。
# https://github.com/becat-oss/therb-notebook
panel_2 = Panel(uploadtherb)
